# Grasshopper definition voronoi_script.gh (Grasshopper 1.0.7)

number_slider = Slider(3, range=0..10)
pointsgen = CSharpScript(b=Slider(5.3, range=0..10))  # -> out, A; inputs b: Double
# ---------- pointsgen: C# ----------
    double x = 0;
    double y = 0;

    List<Point3d> center_points = new List<Point3d>();

    List<Point3d> x_row = new List<Point3d>();






    for (int j = 0; j < 6; j++) {

      for (int i = 0; i < 3; i++) {

        if (i == 1) {
          x_row.Add(new Point3d(x, y - b, 0));
        }
        else {
          x_row.Add(new Point3d(x, y, 0));
          };

        x = x + 10;

        };

      center_points.AddRange(x_row);

      y = y - 10;
      x = 0;

      x_row.Clear();

      };



    A = center_points;
# ---------- pointsgen: C# additional code ----------
  /// <summary>
  /// This method will be called once every solution, before any calls to RunScript.
  /// </summary>
  public override void BeforeRunScript()
  { }
  /// <summary>
  /// This method will be called once every solution, after any calls to RunScript.
  /// </summary>
  public override void AfterRunScript()
  { }
# ---------- end pointsgen ----------
pt = ConstructPoint(XCoordinate=expr("(x*10-10)/2", number_slider), YCoordinate=expr("-((x*10-10)/2)", number_slider), ZCoordinate=0)
dom = ConstructDomain(DomainStart=expr("x*5", number_slider), DomainEnd=expr("-x*5", number_slider))
dom_2 = ConstructDomain(DomainStart=expr("x*5", number_slider), DomainEnd=expr("-x*5", number_slider))
series = Series(Start=0, Step=10, Count=number_slider)
rectangle = Rectangle(Plane=pt, XSize=dom, YSize=Domain(15, -45), Radius=0)  # -> Rectangle, Length
pt_2 = ConstructPoint(XCoordinate=series, YCoordinate=expr("-x", graft(series)), ZCoordinate=0)
voronoi = Voronoi(Points=flatten(pt_2), Boundary=rectangle.Rectangle, BruteForceOverride=False)
pointsgen_2 = CSharpScript(seed=Slider(58, range=0..100))  # -> out, A, X_base, Y_base; inputs seed: Int32
# ---------- pointsgen_2: C# ----------
    double x = 0;
    double y = 0;

    List<Point3d> center_points = new List<Point3d>();
    List<Point3d> x_row = new List<Point3d>();
    List<double> x_base = new List<double>();
    List<double> y_base = new List<double>();
    Random rnd = new Random();



    for (int j = 0; j < 6; j++) {

      for (int i = 0; i < 3; i++) {

        double newrnd = rnd.NextDouble();

        x_row.Add(new Point3d(x + (newrnd * 5) - 2.5, y + (newrnd * 5) - 2.5, 0));
        //x_row.Add(new Point3d(x, y, 0));

        x_base.Add(x - 5);
        y_base.Add(y - 5);

        x = x + 10;

        };

      center_points.AddRange(x_row);


      y = y - 10;
      x = 0;

      x_row.Clear();

      };


    A = center_points;
    X_base = x_base;
    Y_base = y_base;
# ---------- end pointsgen_2 ----------
voronoi_2 = Voronoi(Points=pointsgen_2.A, Boundary=rectangle.Rectangle, BruteForceOverride=False)
clip_path = CSharpScript(cell=voronoi_2, x_base=pointsgen_2.X_base, y_base=pointsgen_2.Y_base)  # -> out, A; inputs cell: list of Polyline, x_base: list of Double, y_base: list of Double
# ---------- clip_path: C# ----------
    List<string> xy = new List<string>();
    List<string> result = new List<string>();
    double x = 0;
    double y = 0;
    string resultString = "";
    result.Add(" ");
    result.Add("/* This file is created automatically using C# script in Rhinoceros Grasshopper */ ");
    result.Add(" ");
    result.Add("/* by grebennikovalex */");
    result.Add(" ");

    


    for (int j = 0; j < cell.Count; j++) {

      cell[j].Transform(Rhino.Geometry.Transform.Scale(new Point3d(x_base[j] + 5, y_base[j] + 5, 0), 0.51));

      Line[] cell_lines = cell[j].GetSegments();

      for (int p = 0; p < cell_lines.Length; p++) {



        x = 10 * (cell_lines[p].ToX - x_base[j]);
        y = 10 * (10 - cell_lines[p].ToY + y_base[j]);

        xy.Add(string.Format("{0:N2}", x));
        xy.Add("% ");

        xy.Add(string.Format("{0:N2}", y));
        xy.Add("%");

        xy.Add(", ");

        };


      xy.RemoveAt(xy.Count - 1);

      resultString = "#id" + j + " {clip-path: polygon( " + string.Join("", xy.ToArray()) + " )}";

      result.Add(resultString);

      xy.Clear();


      };

    A = result;
# ---------- clip_path: C# additional code ----------
  /// <summary>
  /// This method will be called once every solution, before any calls to RunScript.
  /// </summary>
  public override void BeforeRunScript()
  { }
  /// <summary>
  /// This method will be called once every solution, after any calls to RunScript.
  /// </summary>
  public override void AfterRunScript()
  { }
# ---------- end clip_path ----------
panel = Panel(clip_path.A)
